# Grasshopper definition singletissue_model.gh (Grasshopper 0.9.76)
# plug-ins: MeshEdit Components, Kangaroo Components, Kangaroo2 Components

panel = Panel("UNIT CELL HEIGHT")
panel_2 = Panel("creating geometry...")
Z = UnitZ(Factor="1.33")
Z_2 = UnitZ(Factor="1.33")
Z_3 = UnitZ(Factor="1.33")
Z_4 = UnitZ(Factor="1.33")
pt = Point("{1,1,0}")
Z_5 = UnitZ(Factor="1.33")
pt_2 = Point("{1,1,0}")
Z_6 = UnitZ(Factor="1.33")
pt_3 = Point("{1,0,0}")
Z_7 = UnitZ(Factor="1.33")
pt_4 = Point("{1,1,0}")
pt_5 = Point("{0,1,0}")
pt_6 = Point("{1,0,0}")
Z_8 = UnitZ(Factor="1.33")
pt_7 = Point("{0,0,0}")
Z_9 = UnitZ(Factor="1.33")
Z_10 = UnitZ(Factor="1.33")
Z_11 = UnitZ(Factor="1.33")
Z_12 = UnitZ(Factor="1.33")
Z_13 = UnitZ(Factor="1.33")
pt_8 = Point("{0,0,0}")
pt_9 = Point("{0,0,0}")
pt_10 = Point("{0,1,0}")
Z_14 = UnitZ(Factor="1.33")
pt_11 = Point("{0,1,0}")
Z_15 = UnitZ(Factor="1.33")
pt_12 = Point("{1,0,0}")
pt_13 = Point("{0,0,0}")
Z_16 = UnitZ(Factor="1.33")
pt_14 = Point("{1,1,0}")
pt_15 = Point("{0,1,0}")
move = Move(Geometry=pt, Motion=Z)  # -> Geometry, Transform
move_2 = Move(Geometry=pt_2, Motion=Z_2)  # -> Geometry, Transform
move_3 = Move(Geometry=pt_3, Motion=Z_3)  # -> Geometry, Transform
pt_16 = Point("{1,0,0}")
move_4 = Move(Geometry=pt_4, Motion=Z_4)  # -> Geometry, Transform
move_5 = Move(Geometry=pt_6, Motion=Z_5)  # -> Geometry, Transform
move_6 = Move(Geometry=pt_5, Motion=Z_6)  # -> Geometry, Transform
move_7 = Move(Geometry=pt_7, Motion=Z_7)  # -> Geometry, Transform
move_8 = Move(Geometry=pt_8, Motion=Z_8)  # -> Geometry, Transform
move_9 = Move(Geometry=pt_9, Motion=Z_9)  # -> Geometry, Transform
move_10 = Move(Geometry=pt_10, Motion=Z_10)  # -> Geometry, Transform
move_11 = Move(Geometry=pt_11, Motion=Z_11)  # -> Geometry, Transform
move_12 = Move(Geometry=pt_13, Motion=Z_12)  # -> Geometry, Transform
move_13 = Move(Geometry=pt_12, Motion=Z_13)  # -> Geometry, Transform
move_14 = Move(Geometry=pt_14, Motion=Z_14)  # -> Geometry, Transform
move_15 = Move(Geometry=pt_15, Motion=Z_15)  # -> Geometry, Transform
move_16 = Move(Geometry=pt_16, Motion=Z_16)  # -> Geometry, Transform
ln = Line(StartPoint="{0,0,0}", EndPoint="{0,1,0}")
ln_2 = Line(StartPoint="{0,0,0}", EndPoint="{1,0,0}")
ln_3 = Line(StartPoint="{0,0,0}", EndPoint="{1,1,0}")
ln_4 = Line(StartPoint="{1,0,0}", EndPoint="{1,1,0}")
ln_5 = Line(StartPoint="{0,1,0}", EndPoint="{1,1,0}")
ln_6 = Line(StartPoint="{0,1,0}", EndPoint="{1,0,0}")
ln_7 = Line(StartPoint=move_7.Geometry, EndPoint="{0,1,0}")
ln_8 = Line(StartPoint=move_8.Geometry, EndPoint="{1,0,0}")
ln_9 = Line(StartPoint=move_9.Geometry, EndPoint="{1,1,0}")
ln_10 = Line(StartPoint=move_13.Geometry, EndPoint="{1,1,0}")
ln_11 = Line(StartPoint=move_11.Geometry, EndPoint="{1,1,0}")
ln_12 = Line(StartPoint=move_10.Geometry, EndPoint="{1,0,0}")
ln_13 = Line(StartPoint="{0,0,0}", EndPoint=move_6.Geometry)
ln_14 = Line(StartPoint="{0,0,0}", EndPoint=move_3.Geometry)
ln_15 = Line(StartPoint="{0,0,0}", EndPoint=move.Geometry)
ln_16 = Line(StartPoint="{1,0,0}", EndPoint=move_2.Geometry)
ln_17 = Line(StartPoint="{0,1,0}", EndPoint=move_4.Geometry)
ln_18 = Line(StartPoint="{0,0,0}", EndPoint=move_12.Geometry)
ln_19 = Line(StartPoint="{0,1,0}", EndPoint=move_5.Geometry)
ln_20 = Line(StartPoint="{1,0,0}", EndPoint=move_16.Geometry)
ln_21 = Line(StartPoint="{0,1,0}", EndPoint=move_15.Geometry)
ln_22 = Line(StartPoint="{1,1,0}", EndPoint=move_14.Geometry)
panel_3 = Panel("Mesh bottom surface")
Z_17 = UnitZ(Factor="1.33")
panel_4 = Panel("Mesh top surface")
move_17 = Move(Geometry=[ln, ln_2, ln_3, ln_4, ln_5, ln_6], Motion=Z_17)  # -> Geometry, Transform
explode = Explode(Curve=move_17.Geometry, Recursive=True)  # -> Segments, flatten(Vertices)
panel_5 = Panel("""0
1
6
9""")
panel_6 = Panel("""0
1
6
9""")
item = ListItem(List=explode.Vertices, Index=panel_5, Wrap=True)
# ALL LINES AND VERTICES OF THE MODEL
combine = CombineData(Input0=[ln, ln_2, ln_3, ln_4, ln_5, ln_6, move_17.Geometry, ln_7, ln_8, ln_9, ln_10, ln_11, ln_12, ln_13, ln_14, ln_15, ln_16, ln_17, ln_19, ln_18, ln_21, ln_20, ln_22])  # -> Result, Index
# Insertion points for unit cells
panel_7 = Panel("""{0,0,0}
{0,1,0}
{0,2,0}
{0,3,0}
{1,0,0}
{1,1,0}
{1,2,0}
{1,3,0}
{2,0,0}
{2,1,0}
{2,2,0}
{2,3,0}
{3,0,0}
{3,1,0}
{3,2,0}
{3,3,0}""")
# INPUT VERTICES FOR "TISSUES" ON TOP SURFACE, relative to origin
panel_8 = Panel("{2,2,1}")
# TOP SURFACE OF MODEL
group = Group(Objects=move_17.Geometry)
# BOTTOM SURFACE OF MODEL
group_2 = Group(Objects=[ln, ln_2, ln_3, ln_4, ln_5, ln_6])
ungroup = Ungroup(Group=group_2)
explode_2 = Explode(Curve=ungroup, Recursive=True)  # -> Segments, flatten(Vertices)
item_2 = ListItem(List=explode_2.Vertices, Index=panel_6, Wrap=True)
# INPUT VERTICES FOR "TISSUES" ON BOTTOM SURFACE, relative to origin
panel_9 = Panel("")
frompoints = MeshFromPoints(Points=item, UDirection="2", VDirection="2")
frompoints_2 = MeshFromPoints(Points=item_2, UDirection="2", VDirection="2")
move_18 = Move(Geometry=group_2, Motion=panel_7)  # -> Geometry, Transform
move_19 = Move(Geometry=group, Motion=panel_7)  # -> Geometry, Transform
X = UnitX(Factor="0")
Y = UnitY(Factor="0")
move_20 = Move(Geometry=frompoints, Motion=panel_7)  # -> Geometry, Transform
X_2 = UnitX(Factor="0")
move_21 = Move(Geometry=frompoints_2, Motion=panel_7)  # -> Geometry, Transform
group_3 = Group(Objects=combine.Result)
Y_2 = UnitY(Factor="0")
group_4 = Group(Objects=move_18.Geometry)
group_5 = Group(Objects=move_19.Geometry)
Z_18 = UnitZ(Factor="1.33")
pt_17 = Point(panel_8)
mjoin = MeshJoin(Meshes=move_20.Geometry)
move_22 = Move(Geometry=group_3, Motion=panel_7)  # -> Geometry, Transform
mjoin_2 = MeshJoin(Meshes=move_21.Geometry)
move_23 = Move(Geometry=panel_9, Motion=X)  # -> Geometry, Transform
move_24 = Move(Geometry=pt_17, Motion=Z_18)  # -> Geometry, Transform
clean = CombineClean(Meshes=mjoin)
move_25 = Move(Geometry=move_24.Geometry, Motion=X_2)  # -> Geometry, Transform
ungroup_2 = Ungroup(Group=group_4)
ungroup_3 = Ungroup(Group=group_5)
move_26 = Move(Geometry=move_23.Geometry, Motion=Y)  # -> Geometry, Transform
pt_18 = Point(move_26.Geometry)
clean_2 = CombineClean(Meshes=mjoin_2)
ungroup_4 = Ungroup(Group=move_22.Geometry)
move_27 = Move(Geometry=move_25.Geometry, Motion=Y_2)  # -> Geometry, Transform
pt_19 = Point(move_27.Geometry)
show = Show(G=clean)
show_2 = Show(G=clean_2)
ungroup_5 = Ungroup(Group=ungroup_2)
ungroup_6 = Ungroup(Group=ungroup_3)
ungroup_7 = Ungroup(Group=ungroup_4)
combine_2 = CombineData(Input0=ungroup_7)  # -> Result, Index
combine_3 = CombineData(Input0=ungroup_5)  # -> Result, Index
combine_4 = CombineData(Input0=ungroup_6)  # -> Result, Index
explode_3 = Explode(Curve=combine_2.Result, Recursive=True)  # -> Segments, flatten(Vertices)
explode_4 = Explode(Curve=combine_3.Result, Recursive=True)  # -> Segments, flatten(Vertices)
cps = ClosestPoints(Point=pt_18, Cloud=explode_4.Vertices, Count="1")  # -> ClosestPoint, CPIndex, Distance
cir = Circle(Plane=cps.ClosestPoint, Radius="0.1")
explode_5 = Explode(Curve=combine_4.Result, Recursive=True)  # -> Segments, flatten(Vertices)
cps_2 = ClosestPoints(Point=pt_19, Cloud=explode_5.Vertices, Count="1")  # -> ClosestPoint, CPIndex, Distance
cir_2 = Circle(Plane=cps_2.ClosestPoint, Radius="0.1")
ccx = CurveCurve(CurveA=explode_4.Segments, CurveB=flatten(cir))  # -> Points, ParamsA, ParamsB
ccx_2 = CurveCurve(CurveA=explode_5.Segments, CurveB=flatten(cir_2))  # -> Points, ParamsA, ParamsB
trim = TrimTree(Tree=ccx.Points, Depth=1)
trim_2 = TrimTree(Tree=ccx_2.Points, Depth=1)
panel_10 = Panel("simulation reset")
panel_11 = Panel("simulation start/stop")
lng = ListLength(List=trim)
lng_2 = ListLength(List=trim_2)
equals = Equality(FirstNumber=lng, SecondNumber=Slider(1, range=0..5))  # -> Equality, Inequality
equals_2 = Equality(FirstNumber=lng_2, SecondNumber=Slider(2, range=0..5))  # -> Equality, Inequality
equals_3 = Equality(FirstNumber=lng_2, SecondNumber=Slider(1, range=0..5))  # -> Equality, Inequality
panel_12 = Panel("MAIN CONTROLS")
# Traction lines length goal
number_slider = Slider(0.169, range=0..1.2)
equals_4 = Equality(FirstNumber=lng, SecondNumber=Slider(2, range=0..5))  # -> Equality, Inequality
cull = CullPattern(List=explode_4.Segments, CullPattern=equals.Equality)
cull_2 = CullPattern(List=explode_5.Segments, CullPattern=equals_3.Equality)
cull_3 = CullPattern(List=explode_5.Segments, CullPattern=equals_2.Equality)
cull_4 = CullPattern(List=explode_4.Segments, CullPattern=equals_4.Equality)
clean_3 = CleanTree(RemoveNulls=True, RemoveInvalid=True, RemoveEmpty=True, Tree=[cull, cull_4])
clean_4 = CleanTree(RemoveNulls=True, RemoveInvalid=True, RemoveEmpty=True, Tree=[cull_2, cull_3])
# Non-traction lines length goal (no input means rest lengths are starting lengths)
lengthgoal = Slider(2, range=0..2)  # disabled
lengthgoalstrength = Slider(10, range=0..10)
panel_13 = Panel("traction lines")
length_line = LengthLine(Line=[clean_4, clean_3], Length=number_slider, Strength=Slider(30, range=1..50))
show_3 = Show(G=flatten(clean_3))
show_4 = Show(G=flatten(clean_4))
floor = Floor(Strength=1)
length_line_2 = LengthLine(Line=explode_3.Segments, Length=lengthgoal, Strength=lengthgoalstrength)
solver = Solver(
    GoalObjects=[length_line_2, length_line, floor, show, show_2, show_4, show_3],
    Reset=Button(),
    Restart=False,
    Parallel=True,
    Threshold=1e-15,
    Tolerance=0.01,
    AddCurrent=False,
    On=Toggle(True))  # -> V, O
